# Grasshopper definition CityScope_Aalto_tag_scan.gh (Grasshopper 0.9.76)
# plug-ins: Python Interpreter, Firefly.X

# Input Option 1 - Text
panel = Panel("""-1,1-1,-1,-1,-1,-1,-1,-1,-1,-1,-1,-1,-1,-1,-1,-1,-1,-1,-1,-1,-1,-1,-1,-1,-1,-1,-1,-1
-1,-1,-1,-1,-1,-1,-1,-1,-1,-1,-1,-1,-1,-1,-1,-1,-1,-1,-1,-1,-1,-1,-1,-1,-1,-1,-1,-1
-1,-1,-1,-1,-1,-1,-1,-1,-1,-1,-1,-1,-1,-1,-1,-1,-1,-1,-1,-1,-1,-1,-1,-1,-1,-1,-1,-1
-1,-1,-1,-1,-1,-1,-1,-1,-1,-1,-1,-1,-1,-1,-1,-1,-1,-1,-1,-1,-1,-1,-1,-1,-1,-1,-1,-1
-1,-1,-1,-1,-1,-1,-1,-1,-1,-1,-1,-1,-1,-1,-1,-1,-1,-1,-1,-1,-1,-1,-1,-1,-1,-1,-1,-1
-1,-1,-1,-1,-1,-1,-1,-1,-1,-1,-1,-1,5,-1,-1,-1,-1,-1,-1,-1,-1,-1,-1,-1,-1,-1,-1,-1
-1,-1,-1,-1,-1,-1,-1,-1,-1,-1,-1,-1,-1,-1,-1,-1,-1,-1,-1,-1,-1,-1,-1,-1,-1,-1,-1,-1
-1,-1,-1,-1,-1,-1,-1,-1,-1,-1,-1,-1,-1,-1,-1,-1,-1,-1,-1,-1,-1,-1,-1,-1,-1,-1,-1,-1
-1,-1,-1,-1,-1,-1,-1,-1,-1,-1,-1,-1,-1,-1,-1,-1,-1,-1,-1,-1,-1,-1,-1,-1,-1,-1,-1,-1
-1,-1,-1,-1,-1,-1,-1,-1,-1,-1,-1,-1,-1,-1,-1,-1,-1,-1,-1,-1,-1,-1,-1,-1,-1,-1,-1,-1
-1,-1,-1,-1,-1,-1,-1,-1,-1,-1,-1,-1,-1,-1,-1,-1,-1,-1,-1,-1,-1,-1,-1,-1,-1,-1,-1,-1
-1,-1,-1,-1,-1,-1,-1,-1,-1,-1,-1,-1,-1,-1,-1,-1,-1,-1,-1,-1,-1,-1,-1,-1,-1,-1,-1,-1
-1,-1,-1,-1,-1,-1,-1,-1,-1,-1,-1,-1,-1,-1,-1,-1,-1,-1,-1,-1,-1,-1,-1,-1,-1,-1,-1,-1
-1,-1,-1,-1,-1,-1,-1,-1,-1,-1,-1,-1,-1,-1,-1,-1,-1,-1,-1,-1,-1,-1,-1,-1,-1,-1,-1,-1
-1,-1,-1,-1,-1,-1,-1,-1,-1,-1,-1,-1,-1,-1,-1,-1,-1,-1,-1,-1,-1,-1,-1,-1,-1,-1,-1,-1
-1,-1,-1,-1,-1,-1,-1,-1,-1,-1,-1,-1,-1,-1,-1,-1,-1,-1,-1,-1,-1,-1,-1,-1,-1,-1,-1,-1
-1,-1,-1,-1,-1,-1,-1,-1,-1,-1,-1,-1,-1,-1,-1,-1,-1,-1,-1,-1,-1,-1,-1,-1,-1,-1,-1,-1
-1,-1,-1,-1,-1,-1,-1,-1,-1,-1,-1,-1,-1,-1,-1,-1,-1,-1,-1,-1,-1,-1,-1,-1,-1,-1,-1,-1
-1,-1,-1,-1,-1,-1,-1,-1,-1,-1,-1,-1,-1,-1,-1,-1,-1,-1,-1,-1,-1,-1,-1,-1,-1,-1,-1,-1
-1,-1,-1,-1,-1,-1,-1,-1,-1,-1,-1,-1,-1,-1,-1,-1,-1,-1,-1,-1,-1,-1,-1,-1,-1,-1,-1,-1
-1,-1,-1,-1,-1,-1,-1,-1,-1,-1,-1,-1,-1,-1,-1,-1,-1,-1,-1,-1,-1,-1,-1,-1,-1,-1,-1,-1
-1,-1,-1,-1,-1,-1,-1,-1,-1,-1,-1,-1,-1,-1,-1,-1,-1,-1,-1,-1,-1,-1,-1,-1,-1,-1,-1,-1
-1,-1,-1,-1,-1,-1,-1,-1,-1,-1,-1,-1,-1,-1,-1,-1,-1,-1,-1,-1,-1,-1,-1,-1,-1,-1,-1,-1
-1,-1,-1,-1,-1,-1,-1,-1,-1,-1,-1,-1,-1,-1,-1,-1,-1,-1,-1,-1,-1,-1,-1,-1,-1,-1,-1,-1
-1,-1,-1,-1,-1,-1,-1,-1,-1,-1,-1,-1,-1,-1,-1,-1,-1,-1,-1,-1,-1,-1,-1,-1,-1,-1,-1,-1
-1,-1,-1,-1,-1,-1,-1,-1,-1,-1,-1,-1,-1,-1,-1,-1,-1,-1,-1,-1,-1,-1,-1,-1,-1,-1,-1,-1
-1,-1,-1,-1,-1,-1,-1,-1,-1,-1,-1,-1,-1,-1,-1,-1,-1,-1,-1,-1,-1,-1,-1,-1,-1,-1,-1,-1
-1,1-1,-1,-1,-1,-1,-1,-1,-1,-1,-1,-1,-1,-1,-1,-1,-1,-1,-1,-1,-1,-1,-1,-1,-1,-1,-1,-1""")

# ---- group: table rotation in world
number_slider = Slider(30.9, range=-180..180)

# ---- group: cell size (meter)
number_slider_2 = Slider(25.6, range=0..1000)

# ---- group: Int Grid X Extent
# Parameters: Table Defination
number_slider_3 = Slider(28, range=1..30)

# ---- group: Int Grid Y Extent
number_slider_4 = Slider(28, range=1..30)

# ----
_4 = Slider(1, range=1..25)
_1 = Slider(1, range=1..25)
_3 = Slider(1, range=1..25)
# Parameters: Building Heights
_0 = Slider(1, range=1..25)
_2 = Slider(1, range=1..25)
# Defining the floor number for each
# building type.
_5 = Slider(1, range=1..25)

video_stream = WebCamVideoStream()

# ----
# You need to adjust the file path to:
# "[your github folder]\CS_Rhino_Grasshopper_Template\maps\CityMatrix_ML_Cam.PNG"
# Input Option 3 - Camera Steam
path = FilePath("C:\_USER_SANNA\01_PROJEKTIT\_AUNI\01_CityScope_general\03_software\_CityScopeAalto_01\test_screen_shots\WIN_20180619_14_05_52_Pro.jpg")
# Input Option 2 - Camera Snapshot Bitmap
load_bitmap = LoadBitmap(FilePathToImageLocation=path)

# ---- group: Select Input Option Here
# Input Option Selection
# Important: Select input option:
# Option 1 - Text
# Option 2 - WebCam SnapShot
# Opiton 3 - WebCam Stream
list = ValueList({"Input Option 1 - Text": 0, "Input Option 2 - WebCam SnapShot": 1, "Input Option 3 - WebCam Stream": 2}, selected="Input Option 1 - Text")

# ---- group: all color code quarts (no rotation)
panel_2 = Panel("2,0,0,0\t2,1,0,0\t2,0,1,0\t2,0,0,1\t2,1,1,0\t2,1,0,1\t2,0,1,1\t2,1,1,1\t3,0,0,0\t3,1,0,0\t3,0,1,0\t3,0,0,1\t3,1,1,0\t3,1,0,1\t3,0,1,1\t3,1,1,1\t4,0,0,0\t4,1,0,0\t4,0,1,0\t4,0,0,1\t4,1,1,0\t4,1,0,1\t4,0,1,1\t4,1,1,1\t5,0,0,0\t5,1,0,0\t5,0,1,0\t5,0,0,1\t5,1,1,0\t5,1,0,1\t5,0,1,1\t5,1,1,1")

# ---- group: Sample White
# Reference Color
pt = Point(<point referenced from the Rhino model>)

# ---- group: Sample Black
pt_2 = Point(<point referenced from the Rhino model>)

# ---- group: Sample Red
# Grid Sampling
pt_3 = Point(<point referenced from the Rhino model>)

# ---- group: all color code quarts (with rotation)
# Decode Piece ID
panel_3 = Panel("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")

# ---- group: Pts Sample Grid Corner
pt_4 = Point([<point referenced from the Rhino model> x4])

# ----
pline = PolyLine(Vertices=pt_4, Closed=False)

# ---- group: x_ext
int = Integer(number_slider_3)

# ---- group: gridExtent_x
int_2 = Integer(int)

# ---- group: y_ext
int_3 = Integer(number_slider_4)

# ---- group: gridExtent_y
int_4 = Integer(int_3)

# ---- group: latitude
num = Number("24.81614710")

# ---- group: tableRotation
num_2 = Number(number_slider)

# ---- group: longitude
num_3 = Number("60.18643753")

# ---- group: cellSize
num_4 = Number(number_slider_2)

# ----
int_5 = Integer(_5)
int_6 = Integer(_4)
int_7 = Integer(_3)
crv = Curve(<curve referenced from the Rhino model>)
int_8 = Integer(_2)
crv_2 = Curve(<curve referenced from the Rhino model>)
crv_3 = Curve(<curve referenced from the Rhino model>)
int_9 = Integer(_1)
int_10 = Integer(_0)
preview = CustomPreview(Geometry=pline, Shader=ColourSwatch(SwatchColor=RGB(255, 0, 230)))
boundary = BoundarySurfaces(Edges=crv)
boundary_2 = BoundarySurfaces(Edges=crv_3)
boundary_3 = BoundarySurfaces(Edges=crv_2)
multiplication = Multiplication(A=int_4, B=2)
multiplication_2 = Multiplication(A=int_2, B=2)
merge = Merge(Data1=int_10, Data2=int_9, Data3=int_8, Data4=int_7, Data5=int_6, Data6=int_5)

# ---- group: tab
panel_4 = Panel("\t")

# ----
split = TextSplit(Text=panel_3, Separators=panel_4)
mesh = MeshBrep(
    Brep=boundary,
    Settings={GridMaxCount=0, GridMinCount=16, JaggedSeams=False, MaxEdgeLength=0, MinEdgeLength=0.0001, MinTolerance=0, Refine=True, RefineAngle=0, RelativeTolerance=0.65, SimplePlanes=True, Tolerance=0})
mesh_2 = MeshBrep(
    Brep=boundary_2,
    Settings={GridMaxCount=0, GridMinCount=16, JaggedSeams=False, MaxEdgeLength=0, MinEdgeLength=0.0001, MinTolerance=0, Refine=True, RefineAngle=0, RelativeTolerance=0.65, SimplePlanes=True, Tolerance=0})
mesh_3 = MeshBrep(
    Brep=boundary_3,
    Settings={GridMaxCount=0, GridMinCount=16, JaggedSeams=False, MaxEdgeLength=0, MinEdgeLength=0.0001, MinTolerance=0, Refine=True, RefineAngle=0, RelativeTolerance=0.65, SimplePlanes=True, Tolerance=0})

# ---- group: floor height
panel_5 = Panel("3.5")

# ---- group: floor num for each type
int_11 = Integer(merge)

# ----
perspective = Perspective(pt=pt_4, int_2=multiplication_2, int=multiplication)

# ---- group: input option selection
int_12 = Integer(list)

# ---- group: all color quarts data
txt = Text(split)

# ----
lng = ListLength(List=txt)
# For Text Data, simple edit the text panel on
# the left (arrow 1), by change the ID in each
# slot, you change what building module to
# copy to the stage. Currently, ID -1 is blank,
# ID 0 to 5 are 6 different building type.
textformating = TextFormating(txt=panel)
multiplication_3 = Multiplication(A=int_11, B=panel_5)
division = Division(A=lng, B="4")

# ---- group: x
series = Series(Start=0, Step=1, Count=int_2)

# ---- group: y
series_2 = Series(Start=0, Step=1, Count=int_4)

# ---- group: webcam snapshot
data = Data(load_bitmap)

# ---- group: webcam stream
# Everthing below this line is only for
# CityScope scanning. You need a
# physical CityScope table. Or at least
# a screenshot of the camera reading
# of the CityScope table.
data_2 = Data(video_stream)

# ----
panel_6 = Panel(txt)
series_3 = Series(Start=0, Step=1, Count=division)

# ---- group: building height for each type
num_5 = Number(multiplication_3)

# ----
multiplication_4 = Multiplication(A=series_2, B=4)
multiplication_5 = Multiplication(A=series, B=2)
multiplication_6 = Multiplication(A=division, B="4")
pshift = ShiftPaths(Data=series_3, Offset=-1)

# ---- group: keystoned grid pts
pt_5 = Point(perspective)

# ---- group: all module piece ids - from Text Data
int_13 = Integer(textformating)

# ----
multiplication_7 = Multiplication(A=multiplication_4, B=int_2)
pshift_2 = ShiftPaths(Data=pt_5, Offset=-1)

# ---- group: all sample pts
pt_6 = Point(pshift_2)

# ----
repeat = RepeatData(Data=pshift, Length=multiplication_6)
box = CenterBox(Base=pt_6, X=0.003, Y=0.003, Z=0.003)
addition = Addition(A=multiplication_5, B=graft(multiplication_7))
pshift_3 = ShiftPaths(Data=repeat, Offset=-1)

# ---- group: all color quart ids
int_14 = Integer(pshift_3)

# ---- group: all sample boxes
box_2 = Box(box)

# ---- group: all ref colors
col = Colour([RGB(198, 184, 140), RGB(15, 15, 15), RGB(156, 81, 42)])

# ----
panel_7 = Panel(int_14)
pshift_4 = ShiftPaths(Data=addition, Offset=-1)
multiplication_8 = Multiplication(A=int_2, B=2)
panel_8 = Panel(col)
addition_2 = Addition(A=pshift_4, B=multiplication_8)
addition_3 = Addition(A=pshift_4, B=1)
addition_4 = Addition(A=addition_2, B=1)

# ---- group: sample pts
item = ListItem(List=pt_6, Index=addition_2, Wrap=False)
item_2 = ListItem(List=pt_6, Index=pshift_4, Wrap=False)
item_3 = ListItem(List=pt_6, Index=addition_4, Wrap=False)
item_4 = ListItem(List=pt_6, Index=addition_3, Wrap=False)

# ----
addition_5 = Addition(A=item_2, B=item_3)
filter = StreamFilter(Gate=int_12, Stream1=data, Stream2=data_2)
division_2 = Division(A=addition_5, B=2)

# ---- group: quart mid pts
pt_7 = Point(division_2)

# ----
int_15 = Integer([0, 1, 2, 3, 4, 5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])

# ---- group: webcam feed (stream or snapshot)
data_3 = Data(filter)

# CityScope Scanning GH
# Shared Components for Input Option 2 and 3
data_4 = Data(data_3)

# ----
mesh_4 = MeshFromImage(Bmp=data_4, Sx=flatten(Domain(0, 1)), Sy=Domain(0, 1), Z=0, C=True)  # disabled

# ---- group: webcam stream
bmp = BitmapToModify(data_4)

# ----
sample = BitmapSampler(BitmapToModify=bmp, PointToSample=pt_2, BitmapToModify_2=bmp, PointToSample_2=pt_2, bitmap_filter=0)  # -> SampledImageData, SampledImageData_2
sample_2 = BitmapSampler(BitmapToModify=bmp, PointToSample=pt_3, BitmapToModify_2=bmp, PointToSample_2=pt_3, bitmap_filter=0)  # -> SampledImageData, SampledImageData_2
sample_3 = BitmapSampler(BitmapToModify=bmp, PointToSample=pt, BitmapToModify_2=bmp, PointToSample_2=pt, bitmap_filter=0)  # -> SampledImageData, SampledImageData_2
col_2 = Colour(sample.SampledImageData_2)
col_3 = Colour(sample_3.SampledImageData_2)
col_4 = Colour(sample_2.SampledImageData_2)

# ---- group: webcam stream
bmp_2 = BitmapToModify(data_4)

# ----
mcol = MeshColours(Mesh=mesh, Colours=col_2)
mcol_2 = MeshColours(Mesh=mesh_2, Colours=col_4)
mcol_3 = MeshColours(Mesh=mesh_3, Colours=col_3)
preview_2 = CustomPreview(
    Geometry=mcol,
    Shader={ambient=RGB(0, 0, 0), diffuse=RGB(255, 105, 180), emission=RGB(76, 32, 54), shine=0.5, specular=RGB(255, 255, 255), transparency=0})
preview_3 = CustomPreview(
    Geometry=mcol_2,
    Shader={ambient=RGB(0, 0, 0), diffuse=RGB(255, 105, 180), emission=RGB(76, 32, 54), shine=0.5, specular=RGB(255, 255, 255), transparency=0})
preview_4 = CustomPreview(
    Geometry=mcol_3,
    Shader={ambient=RGB(0, 0, 0), diffuse=RGB(255, 105, 180), emission=RGB(76, 32, 54), shine=0.5, specular=RGB(255, 255, 255), transparency=0})
sample_4 = BitmapSampler(BitmapToModify=bmp_2, PointToSample=pt_6, BitmapToModify_2=bmp_2, PointToSample_2=pt_6, bitmap_filter=0)  # -> SampledImageData, SampledImageData_2
merge_2 = Merge(Data1=col_3, Data2=col_2, Data3=col_4)

# ---- group: all sample color
col_5 = Colour(sample_4.SampledImageData_2)

# ----
# Closest Color Code
dist = Distance(PointA=graft(col_5), PointB=col)
lng_2 = ListLength(List=dist)
series_4 = Series(Start=0, Step=1, Count=lng_2)
int_16 = Integer(series_4)
sort = SortList(Keys=dist, ValuesA=int_16)  # -> Keys, ValuesA
item_5 = ListItem(List=sort.ValuesA, Index=0, Wrap=False)
pshift_5 = ShiftPaths(Data=item_5, Offset=-1)
pshift_6 = ShiftPaths(Data=pshift_5, Offset=-1)

# ---- group: color code of each smaple pt
int_17 = Integer(pshift_6)

# ----
item_6 = ListItem(List=col, Index=int_17, Wrap=False)
preview_5 = CustomPreview(Geometry=box_2, Shader=item_6)

# ---- group: color codes
item_7 = ListItem(List=int_17, Index=pshift_4, Wrap=False)
item_8 = ListItem(List=int_17, Index=addition_2, Wrap=False)
item_9 = ListItem(List=int_17, Index=addition_4, Wrap=False)
item_10 = ListItem(List=int_17, Index=addition_3, Wrap=False)

# ----
int_18 = Integer([0, 1, 2, 3, 4, 5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])
int_19 = Integer([0, 1, 2, 3, 4, 5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])

# ---- group: rotation
int_20 = Integer([0, 0, 0, 0, 0, 0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])

# ----
merge_3 = Merge(Data1=graft(item_7), Data2=graft(item_8), Data3=graft(item_9), Data4=graft(item_10))

# ---- group: color code quarts
int_21 = Integer(merge_3)

# ----
rev = ReverseList(List=int_21)
txt_2 = Text(rev)
join = TextJoin(Text=txt_2, Join=",")
pshift_7 = ShiftPaths(Data=join, Offset=-1)

# ---- group: color code quart texts
txt_3 = Text(pshift_7)

# ----
keysearch = KeyValueSearch(Keys=txt, Values=int_14, Search=graft(txt_3))
nullrep = ReplaceNulls(Items=keysearch, Replacements="-1")  # -> Items, Count
pshift_8 = ShiftPaths(Data=nullrep.Items, Offset=-1)

# ---- group: all module piece ids
int_22 = Integer(pshift_8)

# ----
tag = TextTag3D(Location=pt_7, Text=int_22, Size=0.01, Justification=5)
panel_9 = Panel(int_22)

# ---- group: all module piece ids - from CityScope Scanning GH
int_23 = Integer(int_22)

# ---- group: Module ID from selected input option
filter_2 = StreamFilter(Gate=int_12, Stream0=int_13, Stream1=int_23, Stream2=int_23)

# ---- group: module id from selected input option
int_24 = Integer(filter_2)

# ---- group: height for each cell
item_11 = ListItem(List=num_5, Index=int_24, Wrap=False)
nullrep_2 = ReplaceNulls(Items=item_11, Replacements="0.0")  # -> Items, Count

# ---- group: height (meter)
num_6 = Number(nullrep_2.Items)

# ---- group: module type id
int_25 = Integer(int_24)

# ---- group: x
int_26 = Integer(int_18)

# ---- group: height (meter)
num_7 = Number(num_6)

# ---- group: y
int_27 = Integer(int_19)

# ----
panel_10 = Panel(num_7)
# CityMatrix
# 
# "Ryan" Yan Zhang <ryanz@mit.edu>
# MIT Media Lab, Changing Place Group
# September. 2016
# Dynamic
# Input
# Data
panel_11 = Panel(int_25)
panel_12 = Panel(int_20)
panel_13 = Panel(int_26)
panel_14 = Panel(int_27)
# objects
panel_15 = Panel("0.0")

# ---- group: x
# grid
int_28 = Integer(flatten(int_26))

# ---- group: y
int_29 = Integer(flatten(int_27))

# ---- group: rotation
int_30 = Integer(flatten(int_20))

# ---- group: slider1
num_8 = Number(flatten(panel_15))

# ---- group: toggle1
bool = Boolean(flatten("false"))

# ---- group: dockID
int_31 = Integer(flatten("-1"))

# ---- group: x_ext
# Here's the code for the abstract point
# color example I shown in the class.
# It's a very good starting point to build
# your own logic without worring about
# the output part too much.
# 
# Currently, move arround the 2 reference
# points will change the heatmap.
# 
# Mind that the x,y coordinate is from
# 0 to 15, so it is pretty small. Zoom in to
# see the points, or you can use Camera
# "HeatMapPts" saved for you.
# JSON Text Composer
# header
#  > spatial
int_32 = Integer(flatten(int))

# ---- group: dockRotation
int_33 = Integer(flatten("0"))

# ---- group: type id
int_34 = Integer(flatten(int_25))

# ---- group: height (meter)
num_9 = Number(flatten(num_7))

# ---- group: y_ext
int_35 = Integer(flatten(int_3))

# ---- group: latitude
num_10 = Number(flatten(num))

# ---- group: tableRotation
num_11 = Number(flatten(num_2))

# ---- group: cellSize (meter)
num_12 = Number(flatten(num_4))

# ---- group: longitude
num_13 = Number(flatten(num_3))

# ---- group: toggle1 > integer
int_36 = Integer(bool)

# ----
json_composer_py = PythonScript(
    x_ext=int_32,
    y_ext=int_35,
    latitude=num_10,
    longitude=num_13,
    tableRotation=num_11,
    cellSize=num_12,
    x=int_28,
    y=int_29,
    rotation=int_30,
    typeID=int_34,
    height=num_9,
    slider1=num_8,
    toggle1=int_36,
    dockID=int_31,
    dockRotation=int_33)  # -> out, jsonData; inputs x: list, y: list, rotation: list, typeID: list, height: list
# ---------- json_composer_py: Python ----------
import json

# header
spatial = {}
spatial['x_ext'] = x_ext
spatial['y_ext'] = y_ext
spatial['latitude'] = latitude
spatial['longitude'] = longitude
spatial['rotation'] = tableRotation
spatial['cellSize'] = cellSize
block = ['type', 'height', 'rotation']
type = {}
type['-1'] = 'BLANK'
type['0'] = 'RL'
type['1'] = 'RM'
type['2'] = 'RS'
type['3'] = 'OL'
type['4'] = 'OM'
type['5'] = 'OS'
type['6'] = 'ROAD'
mapping = {}
mapping['type'] = type
header = {}
header['spatial'] = spatial
header['block'] = block
header['mapping'] = mapping

# grid
grid = []
cellNum = x_ext * y_ext
for i in range(cellNum):
    grid.append([typeID[i], height[i], rotation[i]])

# objects
objects = {}
objects['slider1'] = slider1
objects['toggle1'] = toggle1
objects['dockID'] = dockID
objects['dockRotation'] = dockRotation

# dump json data
data = {}
data['header'] = header
data['grid'] = grid
data['objects'] = objects
jsonData = json.dumps(data)


"""
predict = jsonData['predict']

grid = predict['grid']
#print str(grid)
rots = []
types = []
xs = []
ys = []
traffics = []
waits = []
solars = []
for cell in grid:
    #print cell
    rot = cell['rot']
    type = cell['type']
    x = cell['x']
    y = cell['y']
    
    # Traffic
    if type == 6: 
        #print "is road!"
        dataResult = cell['data']
        #print dataResult
        traffic = float(dataResult['traffic'])
        #print traffic
        wait = float(dataResult['wait'])
        #print wait
    else:
        #print "is NOT road!"
        traffic = -1.0
        wait = -1.0
    #print traffic
    #print wait
    rots.append(rot)
    types.append(type)
    xs.append(x)
    ys.append(y)
    traffics.append(traffic)
    waits.append(wait)
    
    # Solar
    dataResult = cell['data']
    solar = float(dataResult['solar'])
    solars.append(solar)
    
#print rots
#print types
#print xs
#print ys
#print traffics
#print waits

objects = predict['objects']
densities = objects['densities']

m = objects['metrics']
metrics = []
metrics.append(m['Density']['metric'])
metrics.append(m['Diversity']['metric'])
metrics.append(m['Energy']['metric'])
metrics.append(m['Traffic']['metric'])
metrics.append(m['Solar']['metric'])


AIStep = objects['AIStep']
#print 'AIStep: ' + str(AIStep)
toggle1 = objects['toggle1']
#print 'toggle1: ' + str(toggle1)
slider1 = objects['slider1']
#print 'slider1: ' + str(slider1)
slider2 = objects['slider2']
#print 'slider2: ' + str(slider2)
dockID = objects['dockID']
#print 'dockID: ' + str(dockID)
dockRotation = objects['dockRotation']
#print 'dockRotation: ' + str(dockRotation)
animBlink = objects['animBlink']
#print 'animBlink: ' + str(animBlink)


animActivation = True
"""
# ---------- end json_composer_py ----------

# ---- group: example data format
panel_16 = Panel("""{
  "header" : {
    "spatial": { 
      "x_ext" : 1,
      "y_ext": 1, 
      "latitude":42.360357,
      "longitude": -71.087264,
      "rotation": 0.1,
      "cellSize": 10
    },
    "block": ["x", "y", "rotation", "type", "height"],
    "mapping": {
      "type":{"0":"RL", "1":"RM", "2":"RS", "3":"OL", "4":"OM", "5":"OS", "6":"ROAD"}
    }
  },
  "meta" : {
    "apiv": "v2.0",
    "timestamp": 1517076690,
    "id": "eWRhpRV"
  },
  "grid" : [
    [0, 0, 90, 0, 30.0]
  ],
  "objects" : {
  }
}""")

# ---- group: JSON Text
txt_4 = Text(json_composer_py.jsonData)

# ----
panel_17 = Panel(txt_4)
# Send to CityI/O Server
panel_18 = Panel("https://cityio.media.mit.edu")

# ---- group: table name on server
panel_19 = Panel("cs_aalto")

# ---- group: JSON Text
txt_5 = Text(txt_4)

# ----
join_2 = TextJoin(Text=["api/table/update/", panel_19])
join_3 = TextJoin(Text=["https://cityio.media.mit.edu/api/table/", panel_19])

# ---- group: url for reading the table json data - copy past to broswer
panel_20 = Panel(join_3)

# ---- group: delay sending
dam = DataDam(DataA=txt_5, BufferDelay=5000000, BufferMode=0)

# ----
send_table_data = PythonScript(url=panel_18, path=join_2, jsonString=dam)  # -> out
# ---------- send_table_data: Python ----------
import System 
import System.Net 
import System.Uri
import System.IO
import System.Text.Encoding
import json


def postTable(url,stringData,debug=False):
    webclient = System.Net.WebClient()
    webclient.Headers['Content-type'] = 'text/plain'
    
    if debug:
        
        # simple validation before we send
        try:
            json.loads(stringData)
        except:
            print 'invalid string, revise your string data'
            return
        
        # this will block your process
        data = System.Text.Encoding.Default.GetBytes(stringData)
        webclient.UploadData(url,'POST',data)
        
    else:
        data = System.Text.Encoding.Default.GetBytes(stringData)
        webclient.UploadDataAsync(url,'POST',data)

endpoint = System.Uri('{}/{}'.format(url,path))



postTable(endpoint,jsonString)
# rhino crashes using async callbacks,
# so try the following if something is wrong
# postData(endpoint,jsonString,debug=True)
# ---------- end send_table_data ----------

# ---- group: errors
panel_21 = Panel(send_table_data)

# ==== cluster Perspective
int = ClusterInput()
int_2 = ClusterInput()
pt = ClusterInput()

# ---- group: grid extent y
int_3 = Integer(int)

# ---- group: grid extent x
int_4 = Integer(int_2)

# ---- group: Pts Sample Grid Corner
pt_2 = Point(pt)

# ----
subtraction = Subtraction(A=int_4, B=1)
subtraction_2 = Subtraction(A=int_3, B=1)
item = ListItem(List=pt_2, Index=0, Wrap=False)
item_2 = ListItem(List=pt_2, Index=1, Wrap=False)
item_3 = ListItem(List=pt_2, Index=2, Wrap=False)
item_4 = ListItem(List=pt_2, Index=3, Wrap=False)
pt_3 = Point(item_4)
pt_4 = Point(item)
ln = Line(StartPoint=pt_3, EndPoint=pt_4)
pt_5 = Point(item_2)
ln_2 = Line(StartPoint=pt_4, EndPoint=pt_5)
pt_6 = Point(item_3)
ln_3 = Line(StartPoint=pt_6, EndPoint=pt_3)
ln_4 = Line(StartPoint=pt_5, EndPoint=pt_6)
llx = LineLine(Line1=ln, Line2=ln_4)  # -> ParamA, ParamB, PointA, PointB
pt_7 = Point(llx.PointA)
llx_2 = LineLine(Line1=ln_2, Line2=ln_3)  # -> ParamA, ParamB, PointA, PointB
pt_8 = Point(llx_2.PointA)
vec2pt = Vector2Pt(PointA=pt_8, PointB=pt_7, Unitize=False)  # -> Vector, Length
line = LineSDL(Start=pt_3, Direction=vec2pt.Vector, Length=1)
llx_3 = LineLine(Line1=ln_2, Line2=line)  # -> ParamA, ParamB, PointA, PointB
pt_9 = Point(llx_3.PointA)
ln_5 = Line(StartPoint=pt_3, EndPoint=pt_9)
divide = DivideCurve(Curve=ln_5, Count=subtraction_2, Kinks=False)  # -> Points, Tangents, Parameters
ln_6 = Line(StartPoint=pt_8, EndPoint=divide.Points)
llx_4 = LineLine(Line1=ln_4, Line2=line)  # -> ParamA, ParamB, PointA, PointB
pt_10 = Point(llx_4.PointA)
ln_7 = Line(StartPoint=pt_3, EndPoint=pt_10)
divide_2 = DivideCurve(Curve=ln_7, Count=subtraction, Kinks=False)  # -> Points, Tangents, Parameters
ln_8 = Line(StartPoint=pt_7, EndPoint=divide_2.Points)
ln_9 = Line(StartPoint=pt_8, EndPoint=pt_7)

# ---- group: x
line_2 = Line(ln_8)

# ---- group: y
line_3 = Line(ln_6)

# ----
graft = GraftTree(Tree=ln_6, IncludeEmptyLists=True, IncludeNullItems=True)
llx_5 = LineLine(Line1=line_2, Line2=graft)  # -> ParamA, ParamB, PointA, PointB

# ---- group: keystoned grid pts
pt_11 = Point(llx_5.PointA)

# ----
pt_12 = ClusterOutput(pt_11)

# ==== cluster TextFormating
txt = ClusterInput()
txt_2 = Text(txt)

# ---- group: 'Enter'
panel = Panel("")

# ----
split = TextSplit(Text=txt_2, Separators=panel)
lng = ListLength(List=split)
addition = Addition(A=lng, B=1)
division = Division(A=addition, B=2)
series = Series(Start=0, Step=2, Count=division)
item = ListItem(List=split, Index=series, Wrap=False)
pshift = ShiftPaths(Data=item, Offset=1)
graft = GraftTree(Tree=pshift, IncludeEmptyLists=True, IncludeNullItems=True)
split_2 = TextSplit(Text=graft, Separators=",")
pshift_2 = ShiftPaths(Data=split_2, Offset=-2)
txt_3 = Text(pshift_2)
txt_4 = ClusterOutput(txt_3)
